# Requirement set Transmission_Requirements (R2026a)

## 1 [#3] Engine Operating Limits
The transmission controller shall prevent operation of the engine outside its allowable operating range.

### 1.1 [#4] Maximum Engine Speed
The transmission controller shall prevent engine speed from exceeding 7250 RPM.
Rationale: Higher engine speeds will cause the internal piston forces to excess material limitations.

### 1.2 [#12] Minimum Engine Speed
The transmission controller shall prevent engine speed from falling below 800 rpm

## 2 [#1] Gear Selection Safety
The transmission controller shall permit gear selection only when operating conditions are valid for the requested gear.

### 2.1 [#2] Park Engagement
The transmission controller shall permit engagement of PARK only when |vehSpd| < 0.1 m/s

### 2.2 [#13] Drive Engagement
The transmission controller shall permit engagement of DRIVE only when vehicle speed is greater than -0.5m/s

### 2.3 [#14] Reverse Engagement
The transmission controller shall permit engagement of the reverse gear only when vehicle speed is less than 0.5m/s.

### 2.4 [#15] Neutral Operation
The transmission controller shall permit engagement of the neutral gear refardless of vehicle speed

### 2.5 [#16] Park Engagement Timing
Tge transmission controller shall command the parking actuator to close within 100 ms of a valid park request.

### 2.6 [#17] Park Release Timing
The transmission controller shall command the parking actuator to release within 100 ms of the driver shifting out of park

### 2.7 [#18] Minimum Shift Interval
The transmission controller shall prevent consecutive forward gear shifts from occurring within 0.5 seconds of each other

## 3 [#9] Driver Request Handling
The transmission controller shall process driver gear requests according to transmission operating constraints.

### 3.1 [#10] Park Request Protection
The transmission controller shall always command neutral when park is selected
Rationale: If the transmission is in any drive or reverse gears it will cause undue strain on the engine and torque converter.

## 4 [#11] Vehicle Performance
The vehicle shall accelerate from 0 to 60 mph in less than 12 seconds when wide-open-throttle is applied (100% throttle)
Rationale: If 0-60 acceleration time is greater than 12 seconds it will create unsafe situations on the road during merging and other high-acceleration manoeuvers.